# Grasshopper definition 2_custom_import_osm_data.gh (Grasshopper 1.0.8)
# plug-ins: Urbano2

# Select from dropdown
# or input your own query
osm_feature_query = OsmFeatureQuery(OsmFeatureQuery="(parking)")
# Path to example file
relative_path = RelativePath(FileName="40.7167_40.6998_-74_-74.0234.osm.pbf")
panel = Panel(osm_feature_query)
import_osm_file = ImportOSMFile(OsmFilePath=relative_path, OsmFeatures=panel, Terrain=False, Run=True)  # -> Polylines, Polygons, Points, CoordinateReference, Boundary
