# Grasshopper definition 2_compute_walkscore_by_block.gh (Grasshopper 1.0.8)
# plug-ins: Urbano2

workflow_template = WorkflowTemplate()  # -> Directories, Templates, ExampleProjectSetting, ExampleOSMFilePath, ExampleShapefilePath, ExampleGeojsonPath
import_data_blocks = ImportDataBlocks(ProjectSetting=workflow_template.ExampleProjectSetting, DataSource="urbano synthesized", Terrain=False)

# ----
# Click This to Re-Compute (Slow)
button = Button()

walkscore_component = WalkscoreComponent(
    ProjectSetting=workflow_template.ExampleProjectSetting,
    Geometries=import_data_blocks,
    Run=button,
    WalkscoreCachedScores_0=84.1537034,
    WalkscoreCachedScores_1=89.48663125,
    WalkscoreCachedScores_10=78.13400235,
    WalkscoreCachedScores_100=94.13804601,
    WalkscoreCachedScores_101=75.83531084,
    WalkscoreCachedScores_102=66.65212281,
    WalkscoreCachedScores_103=84.72868621,
    WalkscoreCachedScores_104=90.12551839,
    WalkscoreCachedScores_105=12.24489796,
    WalkscoreCachedScores_106=87.25044028,
    WalkscoreCachedScores_107=97.83788576,
    WalkscoreCachedScores_108=89.50087499,
    WalkscoreCachedScores_109=91.32654318,
    WalkscoreCachedScores_11=64.66411376,
    WalkscoreCachedScores_110=90.26076333,
    WalkscoreCachedScores_111=89.34140431,
    WalkscoreCachedScores_112=91.23185605,
    WalkscoreCachedScores_113=90.00745767,
    WalkscoreCachedScores_114=89.53684512,
    WalkscoreCachedScores_115=83.6047102,
    WalkscoreCachedScores_116=88.95596209,
    WalkscoreCachedScores_117=90.42606915,
    WalkscoreCachedScores_118=90.69912503,
    WalkscoreCachedScores_119=81.99047411,
    WalkscoreCachedScores_12=94.63555134,
    WalkscoreCachedScores_120=91.16602875,
    WalkscoreCachedScores_121=66.540292,
    WalkscoreCachedScores_122=80.76303051,
    WalkscoreCachedScores_123=8.039695923,
    WalkscoreCachedScores_124=12.24489796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)  # -> Geometries, Walkscores
urbano_gradient = UrbanoGradient(
    Reverse=True,
    stops=[0: RGB(234, 38, 0), 0.25: RGB(234, 126, 0), 0.5: RGB(254, 244, 84), 0.75: RGB(173, 203, 249), 1: RGB(75, 107, 169)])
map_settings = MapSettings(Gradient=urbano_gradient, Max="100", Min=Slider(70, range=50..100), Legend=True, LegendTitle="Walkscore", Label=False)
surface = Surface(walkscore_component.Geometries)
draw_map = DrawMap(Geometries=surface, Values=walkscore_component.Walkscores, MapSettings=map_settings)
